# Dynamo custom node v_DoubleToString.dyf (Dynamo 2.3.0.5885)
# category: v-nodes.String.Generate
# Return a string version of float number.

number = Input(number: double)
digits = Input(digits: int = 2)
python_script = Python(IN[0]=number, IN[1]=digits)
# ---------- python_script.python (2 lines) ----------
if IN[1] <= 0: OUT = str(int(round(IN[0], IN[1])))
else: OUT = str(round(IN[0], IN[1]))
# ----------------------------------------
str = Output(python_script)  # "str: string"
