# Dynamo custom node v_RoomNotPlaced.dyf (Dynamo 2.3.0.5885)
# category: v-nodes.Revit.Room
# Determines the if the given room is not placed.

room = Input(room: var[])
area = Room.Area(room=room)
code_block = CodeBlock(area=area) { area>0; }
filterByBoolMask = List.FilterByBoolMask(list=room, mask=code_block)
not_placed = Output(filterByBoolMask.out)
placed = Output(filterByBoolMask.in)
bool = Output(code_block)
