# Dynamo custom node v_ViewAssociatedLevel.dyf (Dynamo 2.3.1.11775)
# category: v-nodes.Revit.Views

view = Input(view: var[])
python_script = Python(IN[0]=view)
# ---------- python_script.python (2 lines) ----------
views = UnwrapElement(IN[0])
OUT = [v.GenLevel for v in views]
# ----------------------------------------
level = Output(python_script)
